# Grasshopper definition ChessBox.gh (Grasshopper 1.0.8)

# ----
# Box Side_2 *Cut*
# Box Side_2 North & South Tabs
# Box Side_2 East & West Tabs
number_slider = Slider(5.8, range=0..20)
rectangle = Rectangle(Plane=PlaneXY(0, 0, 0), XSize=Slider(18.5, range=0..20), YSize=Slider(0, range=0..20), Radius=0)  # -> Rectangle, Length
rectangle_2 = Rectangle(Plane=PlaneXY(-0.5, 1.5, 0), XSize=Slider(0.5, range=0..1), YSize=Slider(3, range=0..20), Radius=0)  # -> Rectangle, Length
# Add your material thickness for the Y size for the North & South tabs!
rectangle_3 = Rectangle(Plane=PlaneXY(6.1, 0, 0), XSize=number_slider, YSize=Slider(0.5, range=0..1), Radius=0)  # -> Rectangle, Length
rectangle_4 = Rectangle(Plane=PlaneXY(0, 0, 0), XSize=Slider(18, range=0..20), YSize=Slider(6, range=0..20), Radius=0)  # -> Rectangle, Length
rectangle_5 = Rectangle(Plane=PlaneXY(6, 6, 0), XSize=Slider(6, range=0..20), YSize=Slider(0.5, range=0..1), Radius=0)  # -> Rectangle, Length
# Add your material thickness for the X size for the East & West tabs!
rectangular_array = RectangularArray(Geometry=rectangle_2.Rectangle, Cell=rectangle.Rectangle, XCount=Slider(2, range=0..20), YCount=Slider(1, range=0..20))  # -> Geometry, Transform

# ----
# Box Side_1 *Cut*
# Box Side_1 North & South Tabs
# Box Side_1 East & West Tabs
number_slider_2 = Slider(17.5, range=0..20)
rectangle_6 = Rectangle(Plane=PlaneXY(0, 0, 0), XSize=number_slider_2, YSize=Slider(0, range=0..20), Radius=0)  # -> Rectangle, Length
# Add your material thickness for the X size for the East & West tabs!
rectangle_7 = Rectangle(Plane=PlaneXY(0, 1.6, 0), XSize=Slider(0.5, range=0..1), YSize=Slider(2.8, range=0..10), Radius=0)  # -> Rectangle, Length
# Add your material thickness for the Y size for the North & South tabs!
rectangle_8 = Rectangle(Plane=PlaneXY(6.1, 0, 0), XSize=Slider(5.8, range=0..20), YSize=Slider(0.5, range=0..1), Radius=0)  # -> Rectangle, Length
rectangle_9 = Rectangle(Plane=PlaneXY(0, 0, 0), XSize=Slider(18, range=0..20), YSize=Slider(6, range=0..20), Radius=0)  # -> Rectangle, Length
rectangle_10 = Rectangle(Plane=PlaneXY(6, 6, 0), XSize=Slider(6, range=0..20), YSize=Slider(0.5, range=0..1), Radius=0)  # -> Rectangle, Length
rectangular_array_2 = RectangularArray(Geometry=rectangle_7.Rectangle, Cell=rectangle_6.Rectangle, XCount=Slider(2, range=0..20), YCount=Slider(1, range=0..20))  # -> Geometry, Transform

# ----
# Box Bottom *Cut*
# Box Bottom North & South Tabs
# Box Top East & West Tabs
number_slider_3 = Slider(17.5, range=0..20)
rectangle_11 = Rectangle(Plane=PlaneXY(0, 0, 0), XSize=number_slider_3, YSize=Slider(0, range=0..20), Radius=0)  # -> Rectangle, Length
rectangle_12 = Rectangle(Plane=PlaneXY(0, 0, 0), XSize=Slider(0, range=0..20), YSize=Slider(17.5, range=0..20), Radius=0)  # -> Rectangle, Length
rectangle_13 = Rectangle(Plane=PlaneXY(0, 6.1, 0), XSize=Slider(0.5, range=0..1), YSize=Slider(5.8, range=0..10), Radius=0)  # -> Rectangle, Length
rectangle_14 = Rectangle(Plane=PlaneXY(6.1, 0, 0), XSize=Slider(5.8, range=0..10), YSize=Slider(0.5, range=0..1), Radius=0)  # -> Rectangle, Length
rectangle_15 = Rectangle(Plane=PlaneXY(0, 0, 0), XSize=Slider(18, range=0..20), YSize=Slider(18, range=0..20), Radius=0)  # -> Rectangle, Length
# Add your material thickness for the X size for the East & West tabs!
rectangular_array_3 = RectangularArray(
    Geometry=rectangle_13.Rectangle,
    Cell=rectangle_11.Rectangle,
    XCount=Slider(2, range=0..20),
    YCount=Slider(1, range=0..20))  # -> Geometry, Transform
# Add your material thickness for the Y size for the North & South tabs!
rectangular_array_4 = RectangularArray(
    Geometry=rectangle_14.Rectangle,
    Cell=rectangle_12.Rectangle,
    XCount=Slider(1, range=0..20),
    YCount=Slider(2, range=0..20))  # -> Geometry, Transform

# ----
# Enter your material thickness here for the Y size!
# Chessboard *cuts* for pieces to slot into
# Chessboard Pattern *Engraved*
number_slider_4 = Slider(0.2, range=0..1)
rectangle_16 = Rectangle(Plane=PlaneXY(0, 0, 0), XSize=Slider(2, range=0..20), YSize=Slider(2, range=0..20), Radius=0)  # -> Rectangle, Length
rectangle_17 = Rectangle(Plane=PlaneXY(0.5, 0.9, 0), XSize=Slider(1, range=0..20), YSize=number_slider_4, Radius=0)  # -> Rectangle, Length
rectangle_18 = Rectangle(Plane=PlaneXY(0, 0, 0), XSize=Slider(2, range=0..20), YSize=Slider(2, range=0..20), Radius=0)  # -> Rectangle, Length
rectangle_19 = Rectangle(Plane=PlaneXY(0, 0, 0), XSize=Slider(2, range=0..20), YSize=Slider(2, range=0..20), Radius=0)  # -> Rectangle, Length
rectangular_array_5 = RectangularArray(
    Geometry=rectangle_19.Rectangle,
    Cell=rectangle_18.Rectangle,
    XCount=Slider(8, range=0..20),
    YCount=Slider(8, range=0..20))  # -> Geometry, Transform
rectangular_array_6 = RectangularArray(
    Geometry=rectangle_17.Rectangle,
    Cell=rectangle_16.Rectangle,
    XCount=Slider(8, range=0..20),
    YCount=Slider(8, range=0..20))  # -> Geometry, Transform

# ----
# Box Top *Cut*
# Box Top North & South Tabs
# Box Top East & West Tabs
number_slider_5 = Slider(18.5, range=0..20)
rectangle_20 = Rectangle(Plane=PlaneXY(0, 0, 0), XSize=number_slider_5, YSize=Slider(0, range=0..20), Radius=0)  # -> Rectangle, Length
rectangle_21 = Rectangle(Plane=PlaneXY(0, 0, 0), XSize=Slider(0, range=0..20), YSize=Slider(18.5, range=0..20), Radius=0)  # -> Rectangle, Length
# Add your material thickness for the X size for the East & West tabs!
rectangle_22 = Rectangle(Plane=PlaneXY(-0.5, 6, 0), XSize=Slider(0.5, range=0..1), YSize=Slider(6, range=0..20), Radius=0)  # -> Rectangle, Length
# Add your material thickness for the Y size for the North & South tabs!
rectangle_23 = Rectangle(Plane=PlaneXY(6, -0.5, 0), XSize=Slider(6, range=0..20), YSize=Slider(0.5, range=0..1), Radius=0)  # -> Rectangle, Length
rectangle_24 = Rectangle(Plane=PlaneXY(0, 0, 0), XSize=Slider(18, range=0..20), YSize=Slider(18, range=0..20), Radius=0)  # -> Rectangle, Length
rectangular_array_7 = RectangularArray(
    Geometry=rectangle_22.Rectangle,
    Cell=rectangle_20.Rectangle,
    XCount=Slider(2, range=0..20),
    YCount=Slider(1, range=0..20))  # -> Geometry, Transform
rectangular_array_8 = RectangularArray(
    Geometry=rectangle_23.Rectangle,
    Cell=rectangle_21.Rectangle,
    XCount=Slider(1, range=0..20),
    YCount=Slider(2, range=0..20))  # -> Geometry, Transform

# ----
# Chesspiece TAB
# Chesspiece STEM (Adjust Y Size for different pieces); Pawn => 1.5; Rook & Knight => 2; Bishop => 2.5; King & Queen => 3
# Chesspiece DIVIDER
number_slider_6 = Slider(0.5, range=0..1)
point = Point(Point(-0.25, 3, 0))
rectangle_25 = Rectangle(Plane=PlaneXY(0, 0, 0), XSize=Slider(1, range=0..20), YSize=number_slider_6, Radius=0)  # -> Rectangle, Length
rectangle_26 = Rectangle(Plane=PlaneXY(-0.25, 0.5, 0), XSize=Slider(1.5, range=0..5), YSize=Slider(2.5, range=0..5), Radius=0)  # -> Rectangle, Length
rectangle_27 = Rectangle(Plane=point, XSize=Slider(1.5, range=0..5), YSize=Slider(0.5, range=0..1), Radius=0)  # -> Rectangle, Length

# ----
# Chesspiece ROOK BASE
# Chesspiece ROOK TOP
number_slider_7 = Slider(0.575, range=0..1)
point_2 = Point(Point(-0.25, 3, 0))
point_3 = Point(Point(-0.25, 3, 0))
point_4 = Point(Point(-0.25, 3, 0))
rectangle_28 = Rectangle(Plane=point_2, XSize=number_slider_7, YSize=Slider(1, range=0..5), Radius=0)  # -> Rectangle, Length
rectangle_29 = Rectangle(Plane=point_3, XSize=Slider(1.5, range=0..5), YSize=Slider(0.5, range=0..1), Radius=0)  # -> Rectangle, Length
rectangle_30 = Rectangle(Plane=point_4, XSize=Slider(0.35, range=0..1), YSize=Slider(1, range=0..5), Radius=0)  # -> Rectangle, Length
rectangular_array_9 = RectangularArray(
    Geometry=rectangle_30.Rectangle,
    Cell=rectangle_28.Rectangle,
    XCount=Slider(3, range=0..20),
    YCount=Slider(1, range=0..20))  # -> Geometry, Transform

# ----
# Chesspiece PAWN TOP
number_slider_8 = Slider(0.5, range=0..1)
point_5 = Point(Point(0.5, 2.75, 0))
circle = Circle(Plane=point_5, Radius=number_slider_8)

# ----
# Chesspiece KING & QUEEN BASE
number_slider_9 = Slider(1.5, range=0..5)
point_6 = Point(Point(-0.25, 4, 0))
rectangle_31 = Rectangle(Plane=point_6, XSize=number_slider_9, YSize=Slider(1, range=0..1), Radius=0)  # -> Rectangle, Length

# ----
# Chesspiece KING TOP
number_slider_10 = Slider(1, range=0..1)
point_7 = Point(Point(0.35, 5, 0))
point_8 = Point(Point(0, 5.5, 0))
rectangle_32 = Rectangle(Plane=point_7, XSize=Slider(0.25, range=0..5), YSize=number_slider_10, Radius=0)  # -> Rectangle, Length
rectangle_33 = Rectangle(Plane=point_8, XSize=Slider(1, range=0..1), YSize=Slider(0.25, range=0..5), Radius=0)  # -> Rectangle, Length

# ----
# Chesspiece KNIGHT BASE
# Chesspiece KNIGHT NOSE
# Chesspiece KNIGHT EARS
number_slider_11 = Slider(1.5, range=0..5)
point_9 = Point(Point(-1, 3.25, 0))
point_10 = Point(Point(0.5, 3.5, 0))
point_11 = Point(Point(0.5, 4, 0))
point_12 = Point(Point(0.75, 4, 0))
circle_2 = Circle(Plane=point_10, Radius=Slider(0.75, range=0..1))
rectangle_34 = Rectangle(Plane=point_9, XSize=number_slider_11, YSize=Slider(0.75, range=0..1), Radius=0)  # -> Rectangle, Length
rectangle_35 = Rectangle(Plane=point_11, XSize=Slider(0.25, range=0..5), YSize=Slider(0.5, range=0..1), Radius=0)  # -> Rectangle, Length
rectangle_36 = Rectangle(Plane=point_12, XSize=Slider(0.25, range=0..5), YSize=Slider(0.5, range=0..1), Radius=0)  # -> Rectangle, Length

# ----
# Chesspiece QUEEN TOP
number_slider_12 = Slider(0.25, range=0..1)
point_13 = Point(Point(0.5, 5, 0))
circle_3 = Circle(Plane=point_13, Radius=number_slider_12)

# ----
# Chesspiece BISHOP BASE
number_slider_13 = Slider(0.5, range=0..1)
point_14 = Point(Point(0.5, 3.75, 0))
circle_4 = Circle(Plane=point_14, Radius=number_slider_13)
