# Grasshopper definition Lotus.gh (Grasshopper 1.0.8)

range = Range(Domain=Domain(0, 1), Steps=Slider(4, range=0..20))
graph_mapper = GraphMapper(
    range,
    x0=0,
    x1=1,
    y0=0,
    y1=1,
    container_name="Bezier",
    cpx=[0, 0.4903223813, 0.7411122918, 1],
    cpy=[0.7492374182, 0.3660373688, 0.8558421135, 0])
multiplication = Multiplication(A=range, B=Slider(15, range=0..30))
range_2 = Range(Domain=Domain(0, 1), Steps=Slider(4, range=0..20))
graph_mapper_2 = GraphMapper(
    range,
    x0=0,
    x1=1,
    y0=0,
    y1=1,
    container_name="Bezier",
    cpx=[0, 0.7809178233, 0.6471575499, 1],
    cpy=[0, 0, 0.332144022, 0.5412768126])
range_3 = Range(Domain=Domain(0, 1), Steps=Slider(3, range=0..20))
graph_mapper_3 = GraphMapper(
    range_2,
    x0=0,
    x1=1,
    y0=0,
    y1=1,
    container_name="Bezier",
    cpx=[0, 0.7985684872, 0.9693055153, 1],
    cpy=[0.7492374182, 0.7029815316, 0.4470928311, 0])
multiplication_2 = Multiplication(A=range_2, B=Slider(12, range=0..30))
graph_mapper_4 = GraphMapper(
    range_2,
    x0=0,
    x1=1,
    y0=0,
    y1=1,
    container_name="Bezier",
    cpx=[0, 0.6739130616, 0.789855063, 1],
    cpy=[0, 0.1449275613, 0.1811594367, 0.9927536249])
graph_mapper_5 = GraphMapper(range_3, x0=0, x1=1, y0=0, y1=1, container_name="Bezier", cpx=[0, 1, 1, 1], cpy=[1, 1, 1, 0])
multiplication_3 = Multiplication(A=range_3, B=Slider(7, range=0..30))
multiplication_4 = Multiplication(A=graph_mapper_2, B=Slider(6, range=0..30))
graph_mapper_6 = GraphMapper(
    range_3,
    x0=0,
    x1=1,
    y0=0,
    y1=1,
    container_name="Bezier",
    cpx=[0, 0.691866219, 1, 1],
    cpy=[0, 0.1295350194, 0.291621387, 1])
expression = Expression(x=graph_mapper, y=Slider(0.417, range=0..30), Expression="pi/2*x*y")
addition = Addition(A=Slider(1, range=0..30), B=multiplication)
construct_point = ConstructPoint(XCoordinate=0, YCoordinate=addition, ZCoordinate=multiplication_4)
multiplication_5 = Multiplication(A=graph_mapper_4, B=Slider(6, range=0..30))
expression_2 = Expression(x=graph_mapper_3, y=Slider(0.417, range=0..30), Expression="pi/2*x*y")
addition_2 = Addition(A=Slider(1, range=0..30), B=multiplication_2)
negative = Negative(Value=expression)
multiplication_6 = Multiplication(A=graph_mapper_6, B=Slider(8, range=0..30))
expression_3 = Expression(x=graph_mapper_5, y=Slider(0.417, range=0..30), Expression="pi/2*x*y")
addition_3 = Addition(A=Slider(1, range=0..30), B=multiplication_3)
construct_point_2 = ConstructPoint(XCoordinate=0, YCoordinate=addition_2, ZCoordinate=multiplication_5)
negative_2 = Negative(Value=expression_2)
construct_point_3 = ConstructPoint(XCoordinate=0, YCoordinate=addition_3, ZCoordinate=multiplication_6)
negative_3 = Negative(Value=expression_3)
rotate = Rotate(Geometry=construct_point, Angle=negative, Plane=PlaneXY(0, 0, 0))  # -> Geometry, Transform
rotate_2 = Rotate(Geometry=construct_point, Angle=expression, Plane=PlaneXY(0, 0, 0))  # -> Geometry, Transform
rotate_3 = Rotate(Geometry=construct_point_2, Angle=negative_2, Plane=PlaneXY(0, 0, 0))  # -> Geometry, Transform
rotate_4 = Rotate(Geometry=construct_point_2, Angle=expression_2, Plane=PlaneXY(0, 0, 0))  # -> Geometry, Transform
rotate_5 = Rotate(Geometry=construct_point_3, Angle=negative_3, Plane=PlaneXY(0, 0, 0))  # -> Geometry, Transform
rotate_6 = Rotate(Geometry=construct_point_3, Angle=expression_3, Plane=PlaneXY(0, 0, 0))  # -> Geometry, Transform
interpolate = Interpolate(Vertices=rotate_2.Geometry, Degree=3, Periodic=False, KnotStyle=1)  # -> Curve, Length, Domain
interpolate_2 = Interpolate(Vertices=rotate.Geometry, Degree=3, Periodic=False, KnotStyle=1)  # -> Curve, Length, Domain
interpolate_3 = Interpolate(Vertices=construct_point, Degree=3, Periodic=False, KnotStyle=1)  # -> Curve, Length, Domain
number_slider = Slider(24, range=0..36)
expression_4 = Expression(x=Slider(26, range=0..36), Expression="2*pi*x")
interpolate_4 = Interpolate(Vertices=rotate_4.Geometry, Degree=3, Periodic=False, KnotStyle=1)  # -> Curve, Length, Domain
interpolate_5 = Interpolate(Vertices=rotate_3.Geometry, Degree=3, Periodic=False, KnotStyle=1)  # -> Curve, Length, Domain
interpolate_6 = Interpolate(Vertices=construct_point_2, Degree=3, Periodic=False, KnotStyle=1)  # -> Curve, Length, Domain
interpolate_7 = Interpolate(Vertices=rotate_6.Geometry, Degree=3, Periodic=False, KnotStyle=1)  # -> Curve, Length, Domain
interpolate_8 = Interpolate(Vertices=rotate_5.Geometry, Degree=3, Periodic=False, KnotStyle=1)  # -> Curve, Length, Domain
interpolate_9 = Interpolate(Vertices=construct_point_3, Degree=3, Periodic=False, KnotStyle=1)  # -> Curve, Length, Domain
number_slider_2 = Slider(36, range=0..36)
loft = Loft(
    Curves=[interpolate.Curve, interpolate_3.Curve, interpolate_2.Curve],
    Options={Adjust=False, Closed=False, LoftEnds=0, LoftSimp=0, LoftType=0, Rebuild=10, Refit=0.01})
expression_5 = Expression(x=Slider(10, range=0..36), Expression="2*pi*x")
number_slider_3 = Slider(11, range=0..36)
expression_6 = Expression(x=Slider(2, range=0..36), Expression="2*pi*x")
range_4 = Range(Domain=expression_4, Steps=number_slider)
loft_2 = Loft(
    Curves=[interpolate_4.Curve, interpolate_6.Curve, interpolate_5.Curve],
    Options={Adjust=False, Closed=False, LoftEnds=0, LoftSimp=0, LoftType=0, Rebuild=10, Refit=0.01})
rotate_7 = Rotate(Geometry=loft, Angle=range_4, Plane=PlaneXY(0, 0, 0))  # -> Geometry, Transform
loft_3 = Loft(
    Curves=[interpolate_7.Curve, interpolate_9.Curve, interpolate_8.Curve],
    Options={Adjust=False, Closed=False, LoftEnds=0, LoftSimp=0, LoftType=0, Rebuild=10, Refit=0.01})
range_5 = Range(Domain=expression_5, Steps=number_slider_2)
range_6 = Range(Domain=expression_6, Steps=number_slider_3)
rotate_8 = Rotate(Geometry=loft_2, Angle=range_5, Plane=PlaneXY(0, 0, 0))  # -> Geometry, Transform
construct_domain = ConstructDomain(DomainStart=Slider(0.47, range=0..1), DomainEnd=Slider(1, range=0..1))
rotate_9 = Rotate(Geometry=loft_3, Angle=range_6, Plane=PlaneXY(0, 0, 0))  # -> Geometry, Transform
construct_domain_2 = ConstructDomain(DomainStart=Slider(0.47, range=0..1), DomainEnd=Slider(1, range=0..1))
range_7 = Range(Domain=construct_domain, Steps=number_slider)
construct_domain_3 = ConstructDomain(DomainStart=Slider(0.47, range=0..1), DomainEnd=Slider(1, range=0..1))
scale_nu = ScaleNU(Geometry=rotate_7.Geometry, Plane=PlaneXY(0, 0, 0), ScaleX=range_7, ScaleY=range_7, ScaleZ=1)  # -> Geometry, Transform
range_8 = Range(Domain=construct_domain_2, Steps=number_slider_2)
scale_nu_2 = ScaleNU(Geometry=rotate_8.Geometry, Plane=PlaneXY(0, 0, 0), ScaleX=range_8, ScaleY=range_8, ScaleZ=1)  # -> Geometry, Transform
range_9 = Range(Domain=construct_domain_3, Steps=number_slider_3)
scale_nu_3 = ScaleNU(Geometry=rotate_9.Geometry, Plane=PlaneXY(0, 0, 0), ScaleX=range_9, ScaleY=range_9, ScaleZ=1)  # -> Geometry, Transform
